# Grasshopper definition Richard_Julia_Weekly Assignment 5.gh (Grasshopper 1.0.8)

# Assignment
# Task 1: WRITE A FUNCTION THAT turns an input curve into a list of N
# lines (i.e. visually these lines should form a
# polyline that approximate the original input curve)
# 
# (Hint: You can set the curve's interval to
#  the range 0.0 - 1.0 to make the math a bit
# easier to work with)
# Task 2: (Optional) Try out various functions and properties in the Points, Vectors, and Curves class.
# 
# This task is supposed to get you a bit more familiar with these RhinoCommon features.
# 
# A possible exercise: Use script to visualise the curvature of  different curves
panel = Panel("C:\Users\freck\OneDrive - University of Waterloo\Documents\GITHUB\CompDes2025\Mini-assignments\MA_05\Richard_Julia_Weekly Assignment 5_Script_Task1.py")
# Task 3: Use what you have learnt so far to generate a geometric design. BE CREATIVE  !
# 
# You must use Curves, Points, Planes, or Curve or a combination of these.
panel_2 = Panel("C:\Users\freck\OneDrive - University of Waterloo\Documents\GITHUB\CompDes2025\Mini-assignments\MA_05\Richard_Julia_Weekly Assignment 5_Script_Task3.py")
read_file = ReadFile(File=panel, PerLineParse=False)
read_file_2 = ReadFile(File=panel_2, PerLineParse=False)
crv = Curve(<curve referenced from the Rhino model>)
python_3_script = Python3Script(script=read_file, x=crv, y=Slider(20, range=0..20))  # -> out, a; inputs x: Curve, y: Int32; unedited script template
python_3_script_2 = Python3Script(
    script=read_file_2,
    x=Slider(50, range=0..100),
    y=Slider(30, range=0..100),
    z="0",
    x_copies=Slider(4, range=0..10),
    y_copies=Slider(5, range=0..10),
    y_spacing=Slider(50, range=0..100),
    z_factor=Slider(25, range=10..50))  # -> out, a, b, c; inputs x: Int32, y: Int32, z: Int32, x_copies: Int32, y_copies: Int32; unedited script template
geometry = Geometry(python_3_script.a)
geometry_2 = Geometry([python_3_script_2.a, python_3_script_2.b, python_3_script_2.c])
panel_3 = Panel(geometry)
panel_4 = Panel(geometry_2)
