# Grasshopper definition Richard_Julia_Assignment 6.gh (Grasshopper 1.0.8)

# (you can use the Stanford bunny mesh for testing)
# Task 1: Write a function that take in a mesh, and return a list of centroid points (for each face).
# 
# Of course, after you define the function, you need to invoke it to see if it works correctly
# Task 2: Find the mesh face that has the largest area.
# (You can visualize the result by drawing a point or a sphere at the mesh face that you found)
# Task 3: Use an attractor (e.g. point, curve, surface) to influence the mesh vertices (For example, pull the vertices toward an attractor point.
# How much each vertex would move should depends on the distance between its position and the attractor object)
panel = Panel("C:\Users\freck\OneDrive - University of Waterloo\Documents\GITHUB\CompDes2025\Mini-assignments\MA_06\Richard_Julia_Assignment 6.py")
# NOTE: no matter what I tried to fix, I kept getting some kind of "bool" error even though I had no type of true/false, success, etc. Task 3 code is currently not running so that the rest of the tasks can still be seen
number_slider = Slider(0.3, range=-5..5)
read_file = ReadFile(File=panel, PerLineParse=False)
construct_point = ConstructPoint(XCoordinate=Slider(0.8, range=-5..5), YCoordinate=Slider(-0.4, range=-5..5), ZCoordinate=number_slider)
bunny_mesh = Mesh(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)
python_3_script = Python3Script(script=read_file, bunny_mesh=bunny_mesh, l=Slider(1, range=0..1), attractor=construct_point)  # -> out, a, b, c; inputs bunny_mesh: Mesh, l: Double, attractor: Point3d; unedited script template
