# Grasshopper definition Richard_Julia-ma_13.gh (Grasshopper 1.0.8)

# The Python component contains a definition for the class Pyramid
# 
# Task 1:
# Define a new method called GetSurfaceArea that returns the total surface area of the pyramid
# 
# Task 2:
# Define a new method called Move that takes in a parameter of type Vector3d, and move the Pyramid according to this vector.
# 
# Task 3:
# Define a new method called Flip that returns a NEW pyramid where the orientation is rotated by 180 degree around its base frame's X axis
# 
# Task 4:
# Extend the Pyramid class into a new, derived class. Add a minimum of 2 new properties and 2 new methods to the class. i.e. a Building class that inherits Pyramid and adds a window property.
number_slider = Slider(8, range=0..25)
vector_xyz = VectorXYZ(XComponent=Slider(5, range=0..25), YComponent=Slider(10, range=0..25), ZComponent=Slider(8, range=0..25))  # -> Vector, Length
python_3_script = Python3Script(
    w=number_slider,
    l=Slider(6, range=0..25),
    h=Slider(10, range=0..25),
    floor_h=Slider(2.87, range=2.8..4.5),
    win_p=Slider(0.4, range=0..1),
    motionVector=vector_xyz.Vector)  # -> out, a, b, surfaceArea, floorPlates, occupancy, totalWindowArea; inputs floor_h: Double
# ---------- python_3_script: Python ----------
"""
Questionnaire: For what purposes did you use Generative AI / LLMs when completing your assignment?
[] Not at all
[x] Which ones did you use? (e.g., ChatGPT, Bard, etc.) Gemini
[X] Explaining programming concepts
[] Practicing coding exercises
[x] Debugging code
[] Reviewing your Python code
[x] Optimizing code
[] Writing or completing code
[x] Other (please specify): suggesting ideas for derived class property and method ideas (I was very tired at the time and couldn't come up with anything interesting)
"""

#TASKS 1-3
import Rhino.Geometry as rg
import math
class Pyramid:
    def __init__(self,baseFrame,width,length,height):
        self.BaseFrame=baseFrame
        self.Width=width
        self.Length=length
        self.Height=height

    def GetEdges(self):
        A=self.BaseFrame.Origin-self.BaseFrame.XAxis*0.5*self.Width+self.BaseFrame.YAxis*0.5*self.Length
        B=self.BaseFrame.Origin+self.BaseFrame.XAxis*0.5*self.Width+self.BaseFrame.YAxis*0.5*self.Length
        C=self.BaseFrame.Origin+self.BaseFrame.XAxis*0.5*self.Width-self.BaseFrame.YAxis*0.5*self.Length
        D=self.BaseFrame.Origin-self.BaseFrame.XAxis*0.5*self.Width-self.BaseFrame.YAxis*0.5*self.Length
        M=self.BaseFrame.Origin+self.BaseFrame.ZAxis*self.Height

        edges=[]
        edges.append(rg.Line(A,B))
        edges.append(rg.Line(B,C))
        edges.append(rg.Line(C,D))
        edges.append(rg.Line(D,A))
        edges.append(rg.Line(A,M))
        edges.append(rg.Line(B,M))
        edges.append(rg.Line(C,M))
        edges.append(rg.Line(D,M))
        return edges

    def GetVolume(self):
        return self.Width*self.Height*self.Length/3

    def ComputeDensity(self,mass):
        volume=self.GetVolume()
        return mass/volume

    def Duplicate(self):
        return Pyramid(self.BaseFrame.Clone(),self.Width,self.Length,self.Height)

    def GetSurfaceArea(self):
        baseArea=self.Width*self.Length
        slantW=math.sqrt((self.Length/2)**2+self.Height**2)
        slantL=math.sqrt((self.Width/2)**2+self.Height**2)
        lateralArea=(self.Width*slantW)+(self.Length*slantL)
        return baseArea+lateralArea

    def Move(self,vector):
        self.BaseFrame.Translate(vector)

    def Flip(self):
        flippedFrame=self.BaseFrame.Clone()
        flippedFrame.Rotate(math.pi,flippedFrame.XAxis,flippedFrame.Origin)
        return Pyramid(flippedFrame,self.Width,self.Length,self.Height)

#TASK 4
class Building(Pyramid):
    def __init__(self,baseFrame,width,length,height,floorHeight,windowPercentage):
        super().__init__(baseFrame,width,length,height)
        self.FloorHeight=floorHeight
        self.WindowPercentage=windowPercentage
        self.NumFloors=int(self.Height//self.FloorHeight)

    def GetTotalWindowArea(self):
        return self.GetSurfaceArea()*self.WindowPercentage

    def GetFloorPlates(self):
        floors=[]

        for i in range(1,self.NumFloors+1):
            z_offset=i*self.FloorHeight
            scale=(self.Height-z_offset)/self.Height
            floor_origin=self.BaseFrame.Origin+self.BaseFrame.ZAxis*z_offset
            floor_plane=rg.Plane(floor_origin,self.BaseFrame.ZAxis)
            rect=rg.Rectangle3d(floor_plane,rg.Interval(-self.Width*scale/2,self.Width*scale/2),rg.Interval(-self.Length*scale/2,self.Length*scale/2))
            floors.append(rect.ToPolyline().ToPolylineCurve())
        return floors

    def CalculateOccupancy(self):
        total_floor_area=0

        for i in range(1,self.NumFloors+1):
            scale=(self.Height-(i*self.FloorHeight))/self.Height
            total_floor_area+=(self.Width*scale)*(self.Length*scale)
        return int(total_floor_area/2.5)

    def Flip(self):
        flippedFrame=self.BaseFrame.Clone()
        flippedFrame.Rotate(math.pi,flippedFrame.XAxis,flippedFrame.Origin)
        return Building(flippedFrame,self.Width,self.Length,self.Height,self.FloorHeight,self.WindowPercentage)

#INPUTS
f_h=floor_h if 'floor_h' in globals() else 3.5
w_p=win_p if 'win_p' in globals() else 0.3
val_w=w if 'w' in globals() else 2.0
val_l=l if 'l' in globals() else 6.0
val_h=h if 'h' in globals() else 4.0

#BUILDING A
building_a=Building(rg.Plane.WorldXY,val_w,val_l,val_h,f_h,w_p)
if 'motionVector' in globals() and motionVector:
    building_a.Move(motionVector)

#BUILDING B
building_b=building_a.Flip()

#OUTPUTS
a=building_a.GetEdges()
b=building_b.GetEdges()
surfaceArea=building_a.GetSurfaceArea()
floorPlates=building_a.GetFloorPlates()
occupancy=building_a.CalculateOccupancy()
totalWindowArea=building_a.GetTotalWindowArea()
# ---------- end python_3_script ----------
panel = Panel(python_3_script.surfaceArea)
panel_2 = Panel(python_3_script.occupancy)
panel_3 = Panel(python_3_script.totalWindowArea)
